% Simulink data dictionary ALS_Project_dd.sldd

Ignition_On = Simulink.Parameter([], DataType="Enum: Ignition")
Ignition_Off = Simulink.Parameter([], DataType="Enum:Ignition")
Ignition = Simulink.Signal(DataType="Enum: Ignition")
Night_mode = Simulink.Parameter([], DataType="Enum:Visual")
Day_mode = Simulink.Parameter([], DataType="Enum: Visual")
Visual = Simulink.Signal(DataType="Enum: Visual")
Highway = Simulink.Parameter([], DataType="Enum: Roads")
City_road = Simulink.Parameter([], DataType="Enum: roads")
Rising_hill = Simulink.Parameter([], DataType="Enum: Roads")
Down_hill = Simulink.Parameter([], DataType="Enum:Roads")
Roads = Simulink.Signal(DataType="Enum: Roads")
Rain_detected = Simulink.Parameter([], DataType="Enum: Weather")
No_Rain_detected = Simulink.Parameter([], DataType="Enum:Weather")
Fog_detected = Simulink.Parameter([], DataType="Enum: Weather")
No_Fog_detected = Simulink.Parameter([], DataType="Enum:Weather")
Weather = Simulink.Signal(DataType="Enum: Weather")
Tunnel_detected = Simulink.Parameter([], DataType="Enum: Tunnel")
No_Tunnel_detected = Simulink.Parameter([], DataType="Enum: Tunnel")
Tunnel = Simulink.Signal(DataType="Enum: Tunnel")
Lane1_right = Simulink.Parameter([], DataType="Enum: Lanes")
Lane1_left = Simulink.Parameter([], DataType="Enum: Lanes")
Lane2_right = Simulink.Parameter([], DataType="Enum: Lanes")
Lane2_left = Simulink.Parameter([], DataType="Enum: Lanes")
Lane3_right = Simulink.Parameter([], DataType="Enum: Lanes")
Lane3_left = Simulink.Parameter([], DataType="Enum: Lanes")
NoVehicle = Simulink.Parameter([], DataType="Enum: Lanes")
Lanes = Simulink.Signal(DataType="Enum: Lanes")
Low_Beam = Simulink.Parameter([], DataType="Enum: Lights")
High_Beam = Simulink.Parameter([], DataType="Enum: Lights")
Corner_Light_Off = Simulink.Parameter([], DataType="Enum: Lights")
Corner_Light_On = Simulink.Parameter([], DataType="Enum: Lights")
Left_Corner_Light_On = Simulink.Parameter([], DataType="Enum: Lights")
Right_Corner_Light_On = Simulink.Parameter([], DataType="Enum: Lights")
Headlights_Off = Simulink.Parameter([], DataType="Enum: Lights")
Fog_light_On = Simulink.Parameter([], DataType="Enum: Lights")
Fog_light_Off = Simulink.Parameter([], DataType="Enum: Lights")
Lights = Simulink.Signal(DataType="Enum:Lights")
Obstacle_detected = Simulink.Parameter([], DataType="Enum: Obstacles")
No_Obstacle_detected = Simulink.Parameter([], DataType="Enum: Obstacles")
Obstacles = Simulink.Signal(DataType="Enum: Obstacles")
Door_locked = Simulink.Parameter([], DataType="Enum: Door_locks")
Door_unlocked = Simulink.Parameter([], DataType="Enum: Door_locks")
Door_locks = Simulink.Signal(DataType="Enum: Door_locks")
Carangle = Simulink.Parameter(25, DataType="uint8")
Time = Simulink.Parameter(2, DataType="uint8")
Distance = Simulink.Parameter(30, DataType="uint8")
Speed = Simulink.Parameter(60, DataType="uint8")
LIW_Angle = Simulink.Parameter(0, DataType="uint8")
RIW_Angle = Simulink.Parameter(0, DataType="uint8")
Als_mode_enable = Simulink.Parameter([], DataType="Enum: Als_mode")
Als_mode_disable = Simulink.Parameter([], DataType="Enum: Als_mode")
Als_mode = Simulink.Signal(DataType="Enum: Als_mode")